# Grasshopper definition data_conversion.gh (Grasshopper 0.9.76)

num = Number()
# Пытается превратить текст в соотв
# тип данных и обратно
txt = Text()

# ----
# Горизонтальная плоскость
# с центром в точке
pt = Point()
pln = Plane(pt)

bool = Boolean()
pt_2 = Point()
# По сути - просто текст, но через
# ПКМ можно выбрать конкретный файл на жестком диске
path = FilePath()
pln_2 = Plane()
# True = 1 False = 0
int = Integer(bool)
col = Colour(txt)
# Центральная точка плоскости
pt_3 = Point(pln_2)
# Вектор из нуля в данную точку
vec = Vector(pt_2)
# Округляет число
int_2 = Integer(num)
int_3 = Integer(txt)
num_2 = Number(txt)
bool_2 = Boolean(txt)
txt_2 = Text([int_3, col, num_2, bool_2])
# Вектора, точки, плоскости и цвета можно
# превращать друг в друга (цвет соответственно ограничен объемом от 0 до 1 по каждой стороне)
pt_4 = Point()
pt_5 = Point()
crv = Curve()
crv_2 = Curve()
col_2 = Colour(pt_4)
# Если кривая замкнутая и плоская,
# то поверхность, ограниченная кривой
srf = Surface(crv)
# Если кривая замкнутая и плоская,
# то плоскость кривой с центром в первом углу
pln_3 = Plane(crv_2)
# Дистанция от нуля
num_3 = Number(pt_5)
pt_6 = Point(col_2)
