# Grasshopper definition input_output.gh (Grasshopper 0.9.76)

# ----
# Цвет
number_slider = Slider(7, range=0..10)
range = Range(Domain=Domain(0, 1), Steps=10)
colour = ColourPicker(PickedColour=RGB(247, 0, 0))
gradient = Gradient(
    LowerLimit=0,
    UpperLimit=1,
    Parameter=range,
    stops=[0: RGB(234, 38, 0), 0.25: RGB(234, 126, 0), 0.5: RGB(254, 244, 84), 0.75: RGB(173, 203, 249), 1: RGB(75, 107, 169)])
wheel = ColourWheel(
    number_slider,
    ColourGrips_Style=10,
    ColourGrips_Grip=[1.919340985, 2.094395102, 4.188790205, 3.141592654],
    ColourGrips_Lum=[0.5126676052, 0.5422679908],
    ColourGrips_Range=[0.1946891262, 0.1946891262, 0.1946891262, 0.1946891262],
    ColourGrips_Sat=[0.2, 0.7087326137])
legend = Legend(Colour=[ColourSwatch(SwatchColor=RGB(255, 255, 255)), colour], Tags=["One", "Two"], LegendType=1)
legend_2 = Legend(Colour=gradient, Tags=["One", "Two"], LegendType=1)
legend_3 = Legend(Colour=wheel, Tags=["One", "Two"], LegendType=1)

# ----
# Дата и время
clock = Clock(SecondHand=True)
calendar = Calendar()
panel = Panel([clock, calendar])

# ----
# Кнопочки
button = Button()
panel_2 = Panel(button)
panel_3 = Panel(Toggle(False))

# ----
# Note - для ввода, визуализации
# и вывода инфрмации
panel_4 = Panel("Hello")
txt = Text("World")
panel_5 = Panel(txt)

# ----
# Sliders
number_slider_2 = Slider(0.457, range=0..1)
десятичные = Panel(number_slider_2)
четные = Panel(Slider(6, range=0..10))
целые = Panel(Slider(3, range=0..10))
md_slider = MDSlider(slider_value=Point(0.5, 0.5, 0.5), SliderMode=0, x_domain=Domain(0, 1), y_domain=Domain(0, 1), z_domain=Domain(0, 1))
_2d = Panel(md_slider)

# ----
# Переключалки
list = ValueList({"One": 1, "Two": 2, "Three": 2² - 1, "Four": Sqrt(16)}, selected="One")
digit_scroller = DigitScroller(Scroller_Digits=12, Scroller_Prefix="Panel", Scroller_Radix=9, Scroller_Value=-2000.25)
panel_6 = Panel(list)
panel_7 = Panel(digit_scroller)

# ----
# Изображение
# Визуализация и получение
# DataTree
# (Описание структуры данных)
viewer = ParamViewer()

# ----
# Геоматрия из файла
pipeline = GeometryPipeline(
    GroupByLayer=False,
    GroupByType=False,
    IncludeHidden=True,
    IncludeLocked=True,
    LayerFilter="*",
    NameFilter="*",
    TypeFilter=0)

# ---- group: visualisation
random = Random(Range=Domain(0, 1), Number="6", Seed=2)
bar_graph = BarGraph(random, BarColor=RGB(255, 0, 90))
pie = PieChart(random)
tracker = ValueTracker(random, TrackerAutoDomain=True, TrackerColour=RGB(255, 155, 0), TrackerPeriod=10, TrackerUpdate=25, TrackerDomain=[0, 1])
graph = QuickGraph(random)
