# Grasshopper definition logics.gh (Grasshopper 0.9.76)

range = Range(Domain=Domain(0, 1), Steps=Slider(20, range=0..100))
gradient = Gradient(LowerLimit=0, UpperLimit=1, Parameter=range, stops=[0: RGB(0, 128, 0), 0.5: RGB(255, 255, 0), 1: RGB(255, 0, 0)])
larger = LargerThan(FirstNumber=range, SecondNumber="0.5")  # -> LargerThan, OrEqualTo
cull = CullPattern(List=gradient, CullPattern=larger.LargerThan)
legend = Legend(Colour=cull, Tags=["One Fish", "Two Fish", "Red Fish", "Blue Fish"], LegendType=1)

series = Series(Start=0, Step=1, Count=10)
# Раскидывает список на два
panel = Panel("4")
larger_2 = LargerThan(FirstNumber=series, SecondNumber=panel)  # -> LargerThan, OrEqualTo
dispatch = Dispatch(List=series, DispatchPattern=larger_2.LargerThan)  # -> ListA, ListB
panel_2 = Panel(dispatch.ListB)
panel_3 = Panel(dispatch.ListA)
panel_4 = Panel(series)
panel_5 = Panel(larger_2.LargerThan)

# ---- group: logics
larger_3 = LargerThan(FirstNumber=Slider(20, range=0..100), SecondNumber="13")  # -> LargerThan, OrEqualTo
panel_6 = Panel(larger_3.LargerThan)
