# Grasshopper definition p1.gh (Grasshopper 0.9.76)

pipeline = GeometryPipeline(
    GroupByLayer=False,
    GroupByType=False,
    IncludeHidden=True,
    IncludeLocked=True,
    LayerFilter="rect",
    NameFilter="*",
    TypeFilter=4)
pcen = PolygonCenter(Polyline=pipeline)  # -> CenterV, CenterE, CenterA

hexgrid = Hexagonal(Plane=PlaneXY(0, 0, 0), Size=Slider(42, range=0..1000), ExtentX=Slider(3, range=0..10), ExtentY=Slider(5, range=0..10))  # -> Cells, Points

avr = Average(Input=flatten(hexgrid.Points))
vec2pt = Vector2Pt(PointA=avr, PointB=pcen.CenterV, Unitize=False)  # -> Vector, Length
move = Move(Geometry=hexgrid.Cells, Motion=vec2pt.Vector)  # -> flatten(Geometry), Transform

reduce = RandomReduce(List=move.Geometry, Reduction=Slider(3, range=0..10), Seed=Slider(4, range=0..10))

crv = Curve(reduce)
pcen_2 = PolygonCenter(Polyline=crv)  # -> CenterV, CenterE, CenterA

dom = ConstructDomain(DomainStart=Slider(0.05, range=0..1), DomainEnd=Slider(0.53, range=0..1))
lng = ListLength(List=pcen_2.CenterV)
random = Random(Range=dom, Number=lng, Seed=Slider(5, range=0..10))

dom_2 = ConstructDomain(DomainStart=Slider(0, range=0..1), DomainEnd=Slider(0.09, range=0..1))
random_2 = Random(Range=dom_2, Number=lng, Seed=Slider(2, range=0..10))  # -> graft(Random)

scale = Scale(Geometry=crv, Center=pcen_2.CenterV, Factor=random)  # -> Geometry, Transform

number_slider = Slider(100, range=0..100)
divide = DivideCurve(Curve=crv, Count=number_slider, Kinks=False)  # -> Points, Tangents, Parameters
divide_2 = DivideCurve(Curve=scale.Geometry, Count=number_slider, Kinks=False)  # -> Points, Tangents, Parameters
dom_3 = ConstructDomain(DomainStart=random_2, DomainEnd=1)
ln = Line(StartPoint=divide.Points, EndPoint=divide_2.Points)
subcrv = SubCurve(BaseCurve=reparameterize(ln), Domain=dom_3)

crv_2 = Curve(subcrv)
