# Grasshopper definition triangular_Noise1.gh (Grasshopper 0.9.76)

pipeline = GeometryPipeline(
    GroupByLayer=False,
    GroupByType=False,
    IncludeHidden=True,
    IncludeLocked=True,
    LayerFilter="rect",
    NameFilter="*",
    TypeFilter=4)
number_slider = Slider(15, range=0..100)
division = Division(A=number_slider, B=2)
drec = DeconstuctRectangle(Rectangle=pipeline)  # -> BasePlane, XInterval, YInterval
cluster = Cluster(domain=drec.XInterval, B=number_slider)
cluster_2 = Cluster(domain=drec.YInterval, B=number_slider)
number_slider_2 = Slider(404, range=0..1000)
range = Range(Domain=Domain(0, 1), Steps=Slider(100, range=0..5000))
sqr = Square(Value=range)
cluster_3 = Cluster_2(U=cluster, V=cluster_2)
crossref = CrossReference(CrossMode=1)  # -> ListA, ListB
remap = RemapNumbers(Value=sqr, Source=Domain(0, 1), Target=cluster)  # -> Mapped, Clipped
remap_2 = RemapNumbers(Value=sqr, Source=Domain(0, 1), Target=cluster_2)  # -> Mapped, Clipped
panel = Panel(remap.Clipped)
pt = ConstructPoint(XCoordinate=remap.Mapped, YCoordinate=remap_2.Mapped, ZCoordinate=0)
pt_2 = Point()
merge = Merge(Data2=cluster_3)  # -> flatten(Result)
area = Area()  # -> Area, Centroid
con = DelaunayEdges(Points=merge, Plane=PlaneXY(0, 0, 0))  # -> Connectivity, Edges

# ==== cluster Cluster
domain = ClusterInput()
B = ClusterInput()
domain_2 = Domain(domain)
dedomain = DeconstructDomain(Domain=domain_2)  # -> Start, End
subtraction = Subtraction(A=dedomain.End, B=B)
addition = Addition(A=dedomain.Start, B=B)
dom = ConstructDomain(DomainStart=addition, DomainEnd=subtraction)
I = ClusterOutput(dom)

# ==== cluster Cluster_2
U = ClusterInput()
V = ClusterInput()
dom² = ConstructDomain²(DomainU=U, DomainV=V)
dedom2num = DeconstructDomain²(Domain=dom²)  # -> UMin, UMax, VMin, VMax
pt = ConstructPoint(XCoordinate=dedom2num.UMin, YCoordinate=dedom2num.VMin, ZCoordinate=0)
pt_2 = ConstructPoint(XCoordinate=dedom2num.UMax, YCoordinate=dedom2num.VMax, ZCoordinate=0)
pt_3 = ConstructPoint(XCoordinate=dedom2num.UMin, YCoordinate=dedom2num.VMax, ZCoordinate=0)
pt_4 = ConstructPoint(XCoordinate=dedom2num.UMax, YCoordinate=dedom2num.VMin, ZCoordinate=0)
merge = Merge(Data1=pt, Data2=pt_2, Data3=pt_3, Data4=pt_4)
R = ClusterOutput(merge)
