# Grasshopper definition unnamed.gh (Grasshopper 0.9.76)
# plug-ins: LunchBox

path = FilePath("C:\Users\user\Desktop\Philipp\Lessons\input_output.gh")
panel = Panel(path)
rhcom = RhinoCommand(SendCommandToggle=Button(), CommandString="_export enter C:\Users\user\Desktop\Philipp\Lessons\1.pdf")
